# Grasshopper definition GeodesicDome-MinaTahaei-KatjaSriedelmeyer.gh (Grasshopper 1.0.7)
# plug-ins: GhPolyhedra, LunchBox

icosphere = IcoSphere(Plane=PlaneXY(0, 0, 0), Scale=Slider(120, range=0..1000), Density=Slider(3, range=0..4))
faceb = FaceBoundaries(Mesh=icosphere)
boundary = BoundarySurfaces(Edges=faceb)
join = BrepJoin(Breps=boundary)  # -> Breps, Closed
box = Box(join.Breps)
debrep = DeconstructBrep(Brep=box)  # -> Faces, Edges, Vertices
item = ListItem(List=reverse(debrep.Edges), Index=0, Wrap=True)
item_2 = ListItem(List=reverse(debrep.Faces), Index=0, Wrap=True)
len = Length(Curve=item)
division = Division(A=len, B=2)
Z = UnitZ(Factor=division)
neg = Negative(Value=Z)
move = Move(Geometry=item_2, Motion=neg)  # -> Geometry, Transform
split = SplitBrep(Brep=join.Breps, Cutter=move.Geometry)
item_3 = ListItem(List=split, Index=0, Wrap=True)
debrep_2 = DeconstructBrep(Brep=item_3)  # -> Faces, Edges, Vertices
frame = PanelFrame(Panel=debrep_2.Faces, ScaleFactor=Slider(0.7, range=0.1..0.9))  # -> PanelFrame, Panel
brep = Brep(frame.Panel)
brep_2 = Brep(frame.PanelFrame)
join_2 = BrepJoin(Breps=brep_2)  # -> Breps, Closed
